# Grasshopper definition 260311-ImageOcclusionPrototype.gh (Grasshopper 1.0.8)
# plug-ins: Pufferfish, DigitalCircularityToolkit, LunchBox

mesh = Mesh([<mesh referenced from the Rhino model> x8])
boxobj = BoxObjectDCT(Geometry=mesh, NumSamples=50, Quantity=1, LengthBuffer=1, WidthBuffer=1, HeightBuffer=1, ID="NoID")  # -> BoxObject, EffectiveBox
planaroutline = PlanarOutlineDCT(Object=boxobj.BoxObject)
height = Slider(200, range=50..800)
width = Slider(175, range=50..800)
area = Area(Geometry=planaroutline)  # -> Area, Centroid
mesh_2 = Mesh([<mesh referenced from the Rhino model> x4])
pt = ConstructPoint(XCoordinate="0", YCoordinate="0", ZCoordinate="0")
division = Division(A=width, B="5")
division_2 = Division(A=height, B="5")
demesh = DeconstructMesh(Mesh=mesh_2)  # -> Vertices, Faces, Colours, Normals
pop3d = Populate3D(Region=mesh_2, Count=Slider(100, range=0..300), Seed=1)
xy = XYPlane(Origin=area.Centroid)
rebcrv = RebuildCurve(Curve=planaroutline, Count=Slider(15, range=0..100), EndTangents=False)
cp = ClosestPoint(Point=pop3d, Cloud=demesh.Vertices)  # -> ClosestPoint, CPIndex, Distance
rectangle = Rectangle(Plane=pt, XSize=division, YSize=division_2, Radius=0)  # -> Rectangle, Length
orient = Orient(Geometry=rebcrv, Source=planaroutline, Target=xy)  # -> Geometry, Transform
orient_2 = Orient(Geometry=mesh, Source=planaroutline, Target=xy)  # -> Geometry, Transform
hull3d = ConvexHull3D(Points=demesh.Vertices)  # -> Hull, Indices
item = ListItem(List=cp.ClosestPoint, Index=0, Wrap=True)
meshnurbs = MeshToNurbs(Mesh=hull3d.Hull)  # -> QuadrangularSurfaces, TriangularSurfaces
py3 = Python3Script(
    interlocking_pixels=Slider(30, range=5..40),
    stone_curves=orient.Geometry,
    wall_width=width,
    wall_height=height,
    pixel_scale="5",
    weight_height=Slider(0.03, range=0..10))  # -> out, a, b, c, d; inputs stone_curves: list of Curve, wall_width: Int32, wall_height: Int32, pixel_scale: Int32
# ---------- py3: Python ----------
#! python3
import sys
sys.path.append(r"D:\Documents\DANIELS\THESIS\01 Models\StablePacking2D-master\src")

# Override interlocking before importing
import place_stone_2d
place_stone_2d.INTERLOCKING_PIXEL = interlocking_pixels

import numpy as np
import Rhino.Geometry as rg
import tempfile
import cv2
from place_stone_2d import (generate_one_wall_best_pose_given_sequence,
                             generate_one_wall_best_pose_given_sequence_given_wall,
                             base_pixel_value, left_bound_pixel_value, right_bound_pixel_value)
from rotate_stone import rotate_axis_align

# ── HELPER FUNCTIONS ───────────────────────────────────────────────────────

def curve_to_binary_image(crv, pixel_scale):
    bbox = crv.GetBoundingBox(True)
    min_pt = bbox.Min
    polyline_curve = crv.ToPolyline(0.1, 5, 0.01, 10000)
    polyline = polyline_curve.ToPolyline()
    pixel_pts = []
    for pt in polyline:
        px = int((pt.X - min_pt.X) * pixel_scale)
        py = int((pt.Y - min_pt.Y) * pixel_scale)
        pixel_pts.append([px, py])
    stone_w = int((bbox.Max.X - bbox.Min.X) * pixel_scale) + 2
    stone_h = int((bbox.Max.Y - bbox.Min.Y) * pixel_scale) + 2
    img = np.zeros((stone_h, stone_w), dtype=np.uint8)
    pts_array = np.array(pixel_pts, dtype=np.int32)
    cv2.fillPoly(img, [pts_array], 1)
    img, _ = rotate_axis_align(img)
    return img.astype('uint8')

def result_to_curves(stone_index_matrix, pixel_scale):
    curves = []
    unique_ids = np.unique(stone_index_matrix)
    h = stone_index_matrix.shape[0]
    boundary_ids = [float(base_pixel_value), float(left_bound_pixel_value), float(right_bound_pixel_value)]
    for sid in unique_ids:
        if sid <= 0:
            continue
        if sid in boundary_ids:
            continue
        mask = np.zeros_like(stone_index_matrix, dtype=np.uint8)
        mask[stone_index_matrix == sid] = 255
        contours, _ = cv2.findContours(mask, cv2.RETR_EXTERNAL, cv2.CHAIN_APPROX_SIMPLE)
        if not contours:
            continue
        contour = contours[0]
        pts = []
        for point in contour:
            px, py = point[0]
            x = px / pixel_scale
            y = (h - py) / pixel_scale
            pts.append(rg.Point3d(x, y, 0))
        if len(pts) > 1:
            pts.append(pts[0])
            curves.append(rg.PolylineCurve(pts))
    return curves

# ── MAIN ───────────────────────────────────────────────────────────────────

try:
    if not hasattr(stone_curves, '__iter__'):
        stone_curves = [stone_curves]

    # Convert all Rhino curves to binary images
    stone_images = []
    for crv in stone_curves:
        img = curve_to_binary_image(crv, pixel_scale)
        stone_images.append(img)

    result_dir = tempfile.mkdtemp()
    sequence = np.arange(len(stone_images))

    log = []

    # ── PASS 1: strict mason criteria ─────────────────────────────────────
    result = generate_one_wall_best_pose_given_sequence(
        wall_i=0,
        result_dir=result_dir,
        sequence=sequence,
        stones=stone_images,
        wall_size=(wall_height, wall_width),
        rotation_angle_options=[0, 45, 90, 135, 180, 225, 270, 315],
        weight_height=weight_height,
        nb_processor=1,
        relaxed_mason_criteria=False
    )

    placed = len(sequence) - len(result['unplaced_stones'])
    log.append(f"Pass 1 (strict): Placed {placed}/{len(sequence)}, Unplaced: {len(result['unplaced_stones'])}")

    # ── PASS 2: strict again on unplaced stones ────────────────────────────
    # Sometimes a second strict pass places more stones
    # because the wall has changed since pass 1
    if result['unplaced_stones']:
        prev_unplaced = len(result['unplaced_stones'])
        result = generate_one_wall_best_pose_given_sequence_given_wall(
            1,
            result['wall'],
            result['wall_id_matrix'],
            result['stone_index_matrix'],
            result['elems'],
            result['contps'],
            result_dir,
            result['unplaced_stones'],
            stone_images,
            (wall_height, wall_width),
            rotation_angle_options=[0, 45, 90, 135, 180, 225, 270, 315],
            weight_height=weight_height,
            nb_processor=1,
            relaxed_mason_criteria=False
        )
        newly_placed = prev_unplaced - len(result['unplaced_stones'])
        log.append(f"Pass 2 (strict again): Placed {newly_placed} more, Unplaced: {len(result['unplaced_stones'])}")

    # ── PASS 3: relaxed criteria on remaining unplaced stones ──────────────
    # This bypasses contact/interlocking requirements
    # so remaining stones can fill gaps
    if result['unplaced_stones']:
        prev_unplaced = len(result['unplaced_stones'])
        result = generate_one_wall_best_pose_given_sequence_given_wall(
            2,
            result['wall'],
            result['wall_id_matrix'],
            result['stone_index_matrix'],
            result['elems'],
            result['contps'],
            result_dir,
            result['unplaced_stones'],
            stone_images,
            (wall_height, wall_width),
            rotation_angle_options=[0, 45, 90, 135, 180, 225, 270, 315],
            weight_height=weight_height,
            nb_processor=1,
            relaxed_mason_criteria=True  # bypass contact rules
        )
        newly_placed = prev_unplaced - len(result['unplaced_stones'])
        log.append(f"Pass 3 (relaxed): Placed {newly_placed} more, Unplaced: {len(result['unplaced_stones'])}")

    # ── OUTPUT ─────────────────────────────────────────────────────────────
    a = result_to_curves(result['stone_index_matrix'], pixel_scale)
    b = "\n".join(log)
    b += f"\n\nFinal: {len(a)} stones placed"
    c = np.unique(result['stone_index_matrix']).tolist()

    # Transformation data for mesh orientation
    transforms = []
    h = result['stone_index_matrix'].shape[0]
    for stone_idx in range(len(stone_images)):
        target_id = float(stone_idx + 1)
        pixels = np.argwhere(result['stone_index_matrix'] == target_id)
        if len(pixels) == 0:
            continue
        center_row = float(np.mean(pixels[:, 0]))
        center_col = float(np.mean(pixels[:, 1]))
        target_x = center_col / pixel_scale
        target_y = (h - center_row) / pixel_scale
        angle_deg = 0.0
        for i, seq_idx in enumerate(sequence):
            if seq_idx == stone_idx:
                # Check index is within bounds of transformation matrix
                if i < result['transformation'].shape[0]:
                    angle_deg = float(result['transformation'][i][2])
                break
        transforms.append(f"{stone_idx},{target_x},{target_y},{angle_deg}")
    d = transforms

except Exception as e:
    import traceback
    a = []
    b = f"Error: {traceback.format_exc()}"
    c = []
    d = []
# ---------- end py3 ----------
pdecon = Deconstruct(Point=item)  # -> XComponent, YComponent, ZComponent
area_2 = Area(Geometry=meshnurbs.TriangularSurfaces)  # -> Area, Centroid
vec = VectorXYZ(XComponent=flatten(pdecon.XComponent), YComponent="0", ZComponent="0")  # -> Vector, Length
sort = SortList(Keys=area_2.Area, ValuesA=meshnurbs.TriangularSurfaces)  # -> Keys, ValuesA
panel = Panel(py3.d)
py3_2 = Python3Script(input_curves=orient.Geometry, meshes=orient_2.Geometry, transforms=py3.d)  # -> out, a, b; inputs input_curves: list of Curve, meshes: list of Mesh, transforms: list of String
# ---------- py3_2: Python ----------
#! python3
import Rhino.Geometry as rg
import math

# Inputs:
# meshes - List Access
# transforms - List Access
# input_curves - List Access

oriented = []

for t in transforms:
    parts = t.split(',')
    stone_idx = int(parts[0])
    target_x = float(parts[1])
    target_y = float(parts[2])
    angle_deg = float(parts[3])
    
    if stone_idx >= len(meshes):
        continue
    if stone_idx >= len(input_curves):
        continue
    
    mesh = meshes[stone_idx]
    mesh_copy = mesh.DuplicateMesh()
    
    # Use original curve center as reference point
    crv = input_curves[stone_idx]
    crv_bbox = crv.GetBoundingBox(True)
    crv_center = crv_bbox.Center
    
    # Get mesh center
    mesh_bbox = mesh_copy.GetBoundingBox(True)
    mesh_center = mesh_bbox.Center
    
    # Step 1: move mesh so XY center matches curve center
    align_to_curve = rg.Transform.Translation(
        rg.Vector3d(
            crv_center.X - mesh_center.X,
            crv_center.Y - mesh_center.Y,
            0
        )
    )
    mesh_copy.Transform(align_to_curve)
    
    # Step 2: mirror across XZ plane (flip Y)
    mirror_y = rg.Transform.Mirror(
        rg.Point3d(crv_center.X, crv_center.Y, 0),
        rg.Vector3d.YAxis
    )
    mesh_copy.Transform(mirror_y)
    
    # Step 3: rotate around curve center
    angle_rad = math.radians(angle_deg)
    rotation = rg.Transform.Rotation(
        angle_rad,
        rg.Vector3d.ZAxis,
        rg.Point3d(crv_center.X, crv_center.Y, 0)
    )
    mesh_copy.Transform(rotation)
    
    # Step 4: translate to final packed position
    translation = rg.Transform.Translation(
        rg.Vector3d(
            target_x - crv_center.X,
            target_y - crv_center.Y,
            0
        )
    )
    mesh_copy.Transform(translation)
    
    oriented.append(mesh_copy)

a = oriented
# ---------- end py3_2 ----------
item_2 = ListItem(List=sort.ValuesA, Index=0, Wrap=True)  # -> Item1, Item
flippln = FlipPlane(Plane=vec.Vector, FlipX=False, FlipY=False, FlipZ=True)  # -> Flipped, R
orient_3 = Orient(Geometry=mesh_2, Source=flatten(item_2.Item1), Target=flippln.Flipped)  # -> Geometry, Transform
boxobj_2 = BoxObjectDCT(Geometry=py3_2.a, NumSamples=50, Quantity=1, LengthBuffer=1, WidthBuffer=1, HeightBuffer=1, ID="NoID")  # -> BoxObject, EffectiveBox
bbox = BoundingBox(Content=orient_3.Geometry, Plane=PlaneXY(0, 0, 0))  # -> Box, Box_2
planaroutline_2 = PlanarOutlineDCT(Object=boxobj_2.BoxObject)
debrep = DeconstructBrep(Brep=bbox.Box)  # -> Faces, Edges, Vertices
area_3 = Area(Geometry=py3.a)  # -> Area, Centroid
len = Length(Curve=debrep.Edges)
area_4 = Area(Geometry=planaroutline_2)  # -> Area, Centroid
vec2pt = Vector2Pt(PointA=area_4.Centroid, PointB=area_3.Centroid, Unitize=False)  # -> Vector, Length
pt_2 = ConstructPoint(XCoordinate=len, YCoordinate=0, ZCoordinate=0)
cullpt = CullDuplicates(Points=pt_2, Tolerance=0.1, CullMode=3)  # -> Points, Indices, Valence
transform = Transform(Geometry=py3_2.a, Transform=vec2pt.Vector)
panel_2 = Panel(cullpt.Indices)
